# Grasshopper definition unnamed.gh (Grasshopper 0.9.76)
# plug-ins: TimerTest

button = Button()
toggle = BooleanToggle(True)
timet = TimerTest(Run=toggle, Reset=button, Number="0")
nickname = TimerTestComponent2(Run=toggle, Reset=button, Number="0")
panel = Panel(nickname)
panel_2 = Panel(timet)
